# Grasshopper definition SynapseExample.gh (Grasshopper 1.0.7)
# plug-ins: Synapse

panel = Panel("""DecimalPlaces
Increment""")
argb = SplitARGB(Colour=ColourSwatch(SwatchColor=RGB(50, 132, 209)), IntegerChannels=True)  # -> Alpha, Red, Green, Blue
panel_2 = Panel("""sliderwidth
maxvalue
minvalue
steps""")
scolor = SynapseColor(Alpha=argb.Alpha, Red=argb.Red, Green=argb.Green, Blue=argb.Blue)
sfont = SynapseFont(FontFamily="Lucida Console", FontSize=8.25, FontStyle=0, Decoration=0)
panel_3 = Panel("""2
2""")
panel_4 = Panel("""115
0.8
0.2
5""")
int = Integer(panel_3)
ss = SynapseSlider(Property=flatten(panel_2), PropertyValue=flatten(panel_4), Coefficient=0.01)  # -> AllProperties, Control
slbl = SynapseLabel(Property=flatten("text"), PropertyValue=flatten("object name"))  # -> AllProperties, Control
stb = SynapseTextBox(Property=flatten("TextColor"), PropertyValue=flatten(scolor))  # -> AllProperties, Control
sbtn = SynapseButton(Property=flatten("Font"), PropertyValue=flatten(sfont))  # -> AllProperties, Control
snud = SynapseNumUpDn(Property=flatten(panel), PropertyValue=flatten(int))  # -> AllProperties, Control
scb = SynapseCheckBox(Property=flatten("TextColor"), PropertyValue=flatten(ColourSwatch(SwatchColor=RGB(178, 43, 154))))  # -> AllProperties, Control
X = Slider(26, range=1..50, expression="x*10")
D = Slider(14, range=5..20)

# ---- group: stack properties
D_2 = Slider(5, range=5..20)
D_3 = Slider(10, range=5..20)
size = SynapseSize(Width=Slider(260, range=100..800), Height=Slider(200, range=100..800))
int_2 = Integer(D_2)
int_3 = Integer(D_3)

# ----
sdm = SynapseDropMenu(Options=flatten(["Alpha", "Beta", "Omega"]))  # -> AllProperties, Control
int_4 = Integer(X)
# some properties won't convert data type automatically;
# manually enforce the integer type
int_5 = Integer(D)
scombo = SynapseComboBox(Options=flatten(["Alpha", "Beta", "Omega"]))  # -> AllProperties, Control
stb_2 = SynapseTextBox(Mask="(000) 000 0000")  # -> AllProperties, Control, AllMasks
panel_5 = Panel("""Some option A
A better option B
Another option C
Last option D""")
merge = Merge(
    Data1=flatten(scb.Control),
    Data2=flatten(sbtn.Control),
    Data3=flatten(slbl.Control),
    Data4=flatten(snud.Control),
    Data5=flatten(ss.Control),
    Data6=flatten(stb.Control))
merge_2 = Merge(Data1=flatten(int_5), Data2=flatten(int_5), Data3=flatten(int_4))
panel_6 = Panel("""Size
Spacing""")
int_6 = Integer("200")
panel_7 = Panel("""padding
spacing
Width""")
txy = SynapseTableXY(Controls=merge, Columns=2)  # -> Coordinates, Dimensions
smt = SynapseMultiTexts(Property=flatten("Width"), PropertyValue=flatten(int_6))  # -> AllProperties, Control
pickone = SynapseSingleSelect(Options=flatten(panel_5))  # -> AllProperties, Control
slb = SynapseListBox(Options=flatten(["Alpha", "Beta", "Omega"]))  # -> AllProperties, Control
sstack = SynapseStack(
    Property=flatten(panel_6),
    PropertyValue=flatten([size, int_2]),
    Controls=flatten([scombo.Control, sdm.Control, stb_2.Control]))  # -> AllProperties, Control
table = SynapseTable(
    Property=flatten(panel_7),
    PropertyValue=flatten(merge_2),
    Controls=flatten(merge),
    ControlLocation=flatten(txy.Coordinates),
    TableDimension=txy.Dimensions)  # -> AllProperties, Control
sxpdr = SynapseExpander(Property=flatten("Expanded"), PropertyValue=flatten(Toggle(True)), Controls=flatten(pickone.Control))  # -> AllProperties, Control
panel_8 = Panel("""Orientation
Size
Spacing""")
merge_3 = Merge(Data1=flatten("horizontal"), Data2=flatten(size), Data3=flatten(int_2))
sstack_2 = SynapseStack(Property=flatten(panel_8), PropertyValue=flatten(merge_3), Controls=flatten([slb.Control, sstack.Control]))  # -> AllProperties, Control
panel_9 = Panel("""Size
Padding
Spacing""")
sstack_3 = SynapseStack(Property=flatten(panel_9), PropertyValue=flatten([size, int_3, int_2]), Controls=flatten([smt.Control, sxpdr.Control]))  # -> AllProperties, Control
sstack_4 = SynapseStack(Property=flatten(panel_9), PropertyValue=flatten([size, int_3, int_2]), Controls=flatten(sstack_2.Control))  # -> AllProperties, Control
Y = Slider(28, range=1..50, expression="x*10")
X_2 = Slider(30, range=1..50, expression="x*10")
padding = Slider(5, range=1..15)
merge_4 = Merge(Data1=flatten(table.Control), Data2=flatten(sstack_3.Control), Data3=flatten(sstack_4.Control))
vec = VectorXYZ(XComponent=X_2, YComponent=Y, ZComponent=0)  # -> Vector, Length
panel_10 = Panel("""Apple
Banana
Cantaloupe""")
resizable = BooleanToggle(False)
topmost = BooleanToggle(True)
pypt = GhPythonScript(x=Slider(50, range=1..50, expression="x*10"), y=Slider(50, range=1..50, expression="x*10"))  # -> out, p; inputs x: Int32, y: Int32
# ---------- pypt: Python ----------
"""creating an Eto.Drawing.Point object for Synapse plugin to consume.
    Inputs:
        x: x coordinate
        y: y coordinate
    Output:
        p: point object"""

__author__ = "wwang"
__version__ = "2021.02.19"

import Eto.Drawing as drw

p = drw.Point(x,y)
# ---------- end pypt ----------
int_7 = Integer(padding)
int_8 = Integer("1")
tab = SynapseTabs(Property=flatten("SelectedIndex"), PropertyValue=flatten(int_8), Controls=flatten(merge_4), TabName=flatten(panel_10))  # -> AllProperties, Control
merge_5 = Merge(
    Data1=flatten(scolor),
    Data2=flatten("NimbleDashboard"),
    Data3=flatten(pypt.p),
    Data4=flatten(vec.Vector),
    Data5=flatten(topmost),
    Data6=flatten(int_7),
    Data7=flatten(resizable))
panel_11 = Panel("""color
title
Location
size
Topmost
Padding
Resizable""")
showwindow = BooleanToggle(False)
swindow = SynapseWindow(
    Show=showwindow,
    Property=flatten(panel_11),
    PropertyValue=flatten(merge_5),
    Contents=flatten(tab.Control),
    ctrlfill=False)
